# Grasshopper definition vase.gh (Grasshopper 1.0.7)

base_circle_r = Slider(8, range=0..10)
height = Slider(10, range=0..10)
rotation = Slider(30, range=0..45)
scale = Slider(0.59, range=0..1)
base_circle_r_2 = GetInteger(base_circle_r, AtLeast=1, AtMost=1, Maximum=2147483647, Minimum=-2147483648, TreeAccess=False)
height_2 = GetInteger(height, AtLeast=1, AtMost=1, Maximum=2147483647, Minimum=-2147483648, TreeAccess=False)
rotation_2 = GetInteger(rotation, AtLeast=1, AtMost=1, Maximum=2147483647, Minimum=-2147483648, TreeAccess=False)
scale_2 = GetNumber(scale, AtLeast=1, AtMost=1, Maximum=1.797693135e+308, Minimum=-1.797693135e+308, TreeAccess=False)
min = Minimum(A=height_2, B="10")
min_2 = Minimum(A=rotation_2, B="10")
min_3 = Minimum(A=scale_2, B="10")
min_4 = Minimum(A=base_circle_r_2, B="10")
Z = UnitZ(Factor=min)
cir = Circle(Plane=PlaneXY(0, 0, 0), Radius=min_4)
move = Move(Geometry=cir, Motion=Z)  # -> Geometry, Transform
Y = UnitY(Factor=1)
division = Division(A=Z, B=2)
area = Area(Geometry=move.Geometry)  # -> Area, Centroid
rot3d = Rotate3D(Geometry=move.Geometry, Angle=degrees(min_2), Center=area.Centroid, Axis=Y)  # -> Geometry, Transform
move_2 = Move(Geometry=rot3d.Geometry, Motion=division)  # -> Geometry, Transform
scale_3 = Scale(Geometry=rot3d.Geometry, Center=area.Centroid, Factor=min_3)  # -> Geometry, Transform
merge = Merge(Data1=cir, Data2=scale_3.Geometry, Data3=move_2.Geometry)
loft = Loft(Curves=merge, Options={Adjust=False, Closed=False, LoftEnds=0, LoftSimp=0, LoftType=0, Rebuild=10, Refit=0.01})

# ---- group: RH_OUT:vase
brep = Brep(loft)
